# Grasshopper definition 3dout.gh (Grasshopper 0.9.76)

number_slider = Slider(124, range=0..200)
number_slider_2 = Slider(91, range=0..100)

# ----
# mesh
path = FilePath("C:\Users\r.hudson\Documents\WORK\projects\LostCity\LostCity\LostCity\bin\Debug\dem.csv")
c_script = CSharpScript(path=path)  # -> out, A; inputs path: String
# ---------- c_script: C# ----------
    StreamReader sr = new StreamReader(path);
    string line = sr.ReadLine();
    DataTree<Point3d> pts = new DataTree<Point3d>();
    double cell = 90;
    int row = 0;
    GH_Path ghpath;
    while(line != null)
    {
      string[] ele = line.Split(',');
      ghpath = new GH_Path(row);
      for(int i = 0;i < ele.Length;i++)
      {

        Point3d p = new Point3d(i * cell, row * -cell, Convert.ToDouble(ele[i]));
        pts.Add(p, ghpath);

      }
      row++;
      line = sr.ReadLine();
    }

    sr.Close();
    A = pts;
# ---------- end c_script ----------
del = DelaunayMesh(Points=flatten(c_script.A), Plane=PlaneXY(0, 0, 0))

number_slider_3 = Slider(50, range=0..200)  # disabled
# sector edge vis
number_slider_4 = Slider(50, range=0..100)  # disabled
path_2 = FilePath("C:\Users\r.hudson\Documents\WORK\projects\LostCity\LostCity\LostCity\bin\Debug\edgeVisTest.csv")  # disabled
c_script_2 = CSharpScript(vrow=number_slider_3, vcol=number_slider_4, points=c_script.A, path=path_2)  # -> out, A; inputs vrow: Int32, vcol: Int32, points: tree of Point3d, path: String; disabled
# ---------- c_script_2: C# ----------
    StreamReader sr = new StreamReader(path);
    string line = sr.ReadLine();
    DataTree<Line> los = new DataTree<Line>();

    int row = 0;
    Point3d vp = points[new GH_Path(vrow), vcol];

    while(line != null)
    {
      string[] ele = line.Split(',');

      for(int i = 0;i < ele.Length;i++)
      {

        if(ele[i] == "1")
        {
          Point3d temp = points[new GH_Path(row), i];
          Line l = new Line(vp, temp);
          los.Add(l);
        }

      }
      row++;
      line = sr.ReadLine();
    }

    sr.Close();
    A = los;
# ---------- end c_script_2 ----------

# ----
# sector selection
# Visible single point
number_slider_5 = Slider(1, range=0..10)  # disabled
c_script_3 = CSharpScript(vrow=number_slider_3, vcol=number_slider_4, points=c_script.A, sector=number_slider_5)  # -> out, A; inputs vrow: Int32, vcol: Int32, points: tree of Point3d; disabled
# ---------- c_script_3: C# ----------
    StreamReader sr = new StreamReader(@"C:\Users\r.hudson\Documents\WORK\projects\LostCity\LostCity\LostCity\bin\Debug\sectorVisTest-" + sector + ".csv");
    string line = sr.ReadLine();
    DataTree<Point3d> pts = new DataTree<Point3d>();
    int row = 0;
    int visScore = 0;
    while(line != null)
    {
      string[] ele = line.Split(',');
      for(int i = 0;i < ele.Length;i++)
      {
        visScore = Convert.ToInt32(ele[i]);
        if(visScore > 0)
        {
          Point3d sp = points[new GH_Path(Convert.ToInt32(row)), Convert.ToInt32(i)];
          pts.Add(sp);
        }
      }
      row++;
      line = sr.ReadLine();
    }

    sr.Close();
    A = pts;
# ---------- end c_script_3 ----------

c_script_4 = CSharpScript(vrow=number_slider_3, vcol=number_slider_4, points=c_script.A, sector=number_slider_5)  # -> out, A; inputs vrow: Int32, vcol: Int32, points: tree of Point3d; disabled
# ---------- c_script_4: C# ----------
    StreamReader sr = new StreamReader(@"C:\Users\r.hudson\Documents\WORK\projects\LostCity\LostCity\LostCity\bin\Debug\sectorCheck_"+sector+".csv");
    string line = sr.ReadLine();
    DataTree<Point3d> pts = new DataTree<Point3d>();

    while(line != null)
    {
      string[] ele = line.Split(',');
      Point3d sp = points[new GH_Path(Convert.ToInt32(ele[0])), Convert.ToInt32(ele[1])];
      pts.Add(sp);
      line = sr.ReadLine();
    }

    sr.Close();
    A = pts;
# ---------- end c_script_4 ----------

path_3 = FilePath("C:\Users\r.hudson\Documents\WORK\projects\LostCity\LostCity\LostCity\bin\Debug\ciudadPViewShed.csv")

path_4 = DataPath(number_slider_3)  # disabled
item = TreeItem(Tree=c_script.A, Path=path_4, Index=number_slider_4, Wrap=True)  # disabled
ln = Line(StartPoint=item, EndPoint=c_script_3.A)  # disabled

path_5 = DataPath(number_slider)
c_script_5 = CSharpScript(vrow=number_slider, vcol=number_slider_2, points=c_script.A, path=path_3)  # -> out, A; inputs vrow: Int32, vcol: Int32, points: tree of Point3d, path: String
# ---------- c_script_5: C# ----------
    StreamReader sr = new StreamReader(path);
    string line = sr.ReadLine();
    DataTree<Point3d> pts = new DataTree<Point3d>();
    int row = 0;
    int visScore = 0;
    while(line != null)
    {
      string[] ele = line.Split(',');
      for(int i = 0;i < ele.Length;i++)
      {
        visScore = Convert.ToInt32(ele[i]);
        if(visScore > 0)
        {
          Point3d sp = points[new GH_Path(Convert.ToInt32(row)), Convert.ToInt32(i)];
          pts.Add(sp);
        }
      }
      row++;
      line = sr.ReadLine();
    }

    sr.Close();
    A = pts;
# ---------- end c_script_5 ----------
item_2 = TreeItem(Tree=c_script.A, Path=path_5, Index=number_slider_2, Wrap=True)
ln_2 = Line(StartPoint=item_2, EndPoint=c_script_5.A)

# ----
# Point locator
# outputs row column indices for a ref point
panel = Panel("""11.140131, 10.975654, -74.000914, -73.836385

CP 11.037920, -73.925191""")
multiplication = Multiplication(A=Slider(179, range=0..1000), B=Slider(0.00083333, range=0..0.001))
_11_139999999999999 = Number(11.14)
_74_000833333333333 = Number(-74.00083333)
addition = Addition(A=_74_000833333333333, B=multiplication)
subtraction = Subtraction(A=addition, B=_74_000833333333333)
subtraction_2 = Subtraction(A=_11_139999999999999, B=Slider(11.037, range=0..100))
subtraction_3 = Subtraction(A=addition, B=Slider(-73.925191, range=-180..100))
division = Division(A=subtraction_3, B=subtraction)
W = Curve(<curve referenced from the Rhino model>)
E = Curve(<curve referenced from the Rhino model>)
Z = UnitZ(Factor=1)

subtraction_4 = Subtraction(A=_11_139999999999999, B=multiplication)

# ----
# cumulative color mesh
path_6 = FilePath("C:\Users\r.hudson\Documents\WORK\projects\LostCity\LostCity\LostCity\bin\Debug\ciudadPViewShed.csv")
c_script_6 = CSharpScript(path=path_6)  # -> out, A; inputs path: String
# ---------- c_script_6: C# ----------
    StreamReader sr = new StreamReader(path);
    string line = sr.ReadLine();
    DataTree<int> visscores = new DataTree<int>();
    int row = 0;
    int visScore = 0;
    while(line != null)
    {
      string[] ele = line.Split(',');
      for(int i = 0;i < ele.Length;i++)
      {
        visScore = Convert.ToInt32(ele[i]);
        visscores.Add(visScore, new GH_Path(row));
      }
      row++;
      line = sr.ReadLine();
    }

    sr.Close();
    A = visscores;
# ---------- end c_script_6 ----------
flatten = FlattenTree(Tree=c_script_6.A, Path="{0}")
bnd = Bounds(Numbers=flatten)
demesh = DeconstructMesh(Mesh=del)  # -> Vertices, Faces, Colours, Normals
dedomain = DeconstructDomain(Domain=bnd)  # -> Start, End
gradient = Gradient(
    LowerLimit=dedomain.Start,
    UpperLimit=dedomain.End,
    Parameter=flatten,
    stops=[0: RGB(105, 105, 105), 0.994: RGB(255, 255, 255)])

subtraction_5 = Subtraction(A=_11_139999999999999, B=subtraction_4)
division_2 = Division(A=subtraction_2, B=subtraction_5)
eval = EvaluateCurve(Curve=reparameterize(W), Parameter=division_2)  # -> Point, Tangent, Angle
eval_2 = EvaluateCurve(Curve=reparameterize(E), Parameter=division_2)  # -> Point, Tangent, Angle
ln_3 = Line(StartPoint=eval_2.Point, EndPoint=eval.Point)
eval_3 = EvaluateCurve(Curve=reparameterize(ln_3), Parameter=division)  # -> Point, Tangent, Angle
project = ProjectPoint(Point=eval_3.Point, Direction=Z, Geometry=del)  # -> Point, Index
cp = ClosestPoint(Point=project.Point, Cloud=demesh.Vertices)  # -> ClosestPoint, CPIndex, Distance
c_script_7 = CSharpScript(pts=c_script.A, p=cp.ClosestPoint)  # -> out, A; inputs pts: tree of Point3d, p: Point3d
# ---------- c_script_7: C# ----------
    double dist = 0;
    double mindist = 100000000;
    GH_Path path;
    int[] index = new int[2];
    for(int i = 0;i < pts.BranchCount;i++)
    {
      path = new GH_Path(i);
      for(int j = 0;j < pts.Branch(i).Count;j++)
      {
        dist = pts[path, j].DistanceTo(p);
        if(dist < mindist)
        {
          mindist = dist;
          index[0] = i;
          index[1] = j;
        }
      }
    }
    A =index;
# ---------- end c_script_7 ----------

gradient_2 = Gradient(
    LowerLimit=dedomain.Start,
    UpperLimit=dedomain.End,
    Parameter=flatten,
    stops=[0: RGBA(255, 255, 255, 0), 0: RGB(170, 235, 41), 0: RGB(0, 98, 0), 0: RGB(81, 175, 17), 1: RGB(255, 255, 0)])

conmesh = ConstructMesh(Vertices=demesh.Vertices, Faces=demesh.Faces, Colours=gradient_2)
