# Grasshopper definition 3dout2.gh (Grasshopper 0.9.76)

# ----
# mesh
path = FilePath("C:\Users\r.hudson\Documents\WORK\projects\LostCity\LostCity\LostCity\bin\Debug\dem.csv")  # disabled
c_script = CSharpScript(path=path)  # -> out, A; inputs path: String; disabled
# ---------- c_script: C# ----------
    StreamReader sr = new StreamReader(path);
    string line = sr.ReadLine();
    DataTree<Point3d> pts = new DataTree<Point3d>();
    double cell = 90;
    int row = 0;
    GH_Path ghpath;
    while(line != null)
    {
      string[] ele = line.Split(',');
      ghpath = new GH_Path(row);
      for(int i = 0;i < ele.Length;i++)
      {

        Point3d p = new Point3d(i * cell, row * -cell, Convert.ToDouble(ele[i]));
        pts.Add(p, ghpath);

      }
      row++;
      line = sr.ReadLine();
    }

    sr.Close();
    A = pts;
# ---------- end c_script ----------
del = DelaunayMesh(Points=flatten(c_script.A), Plane=PlaneXY(0, 0, 0))  # disabled

number_slider = Slider(91, range=0..100)  # disabled
number_slider_2 = Slider(90, range=0..100)  # disabled
number_slider_3 = Slider(120, range=0..1000)  # disabled
number_slider_4 = Slider(128, range=0..1000)  # disabled
c_script_2 = CSharpScript(points=c_script.A, startRow=number_slider_3, endRow=number_slider_4, startCol=number_slider_2, endCol=number_slider)  # -> out, A; inputs points: tree of Point3d, startRow: Int32, endRow: Int32, startCol: Int32, endCol: Int32; disabled
# ---------- c_script_2: C# ----------
    DataTree<Point3d> pts = new DataTree<Point3d>();

    for(int i = startRow;i <= endRow;i++)
    {
      for(int j = startCol;j <= endCol;j++)
      {
        Point3d sp = points[new GH_Path(Convert.ToInt32(i)), Convert.ToInt32(j)];
        pts.Add(sp);
      }
    }

    A = pts;
# ---------- end c_script_2 ----------

# ----
# Point locator
# outputs row column indices for a ref point
panel = Panel("""11.140131, 10.975654, -74.000914, -73.836385

CP 11.037920, -73.925191""")  # disabled
number_slider_5 = Slider(0.00083333, range=0..0.001)  # disabled
number_slider_6 = Slider(179, range=0..1000)  # disabled
multiplication = Multiplication(A=number_slider_6, B=number_slider_5)  # disabled
number_slider_7 = Slider(11.037, range=0..100)  # disabled
_11_139999999999999 = Number(11.14)  # disabled
number_slider_8 = Slider(-73.925191, range=-180..100)  # disabled
_74_000833333333333 = Number(-74.00083333)  # disabled
addition = Addition(A=_74_000833333333333, B=multiplication)  # disabled
subtraction = Subtraction(A=addition, B=_74_000833333333333)  # disabled
subtraction_2 = Subtraction(A=_11_139999999999999, B=number_slider_7)  # disabled
subtraction_3 = Subtraction(A=addition, B=number_slider_8)  # disabled
division = Division(A=subtraction_3, B=subtraction)  # disabled
W = Curve(<curve referenced from the Rhino model>)  # disabled
E = Curve(<curve referenced from the Rhino model>)  # disabled
Z = UnitZ(Factor=1)  # disabled

subtraction_4 = Subtraction(A=_11_139999999999999, B=multiplication)  # disabled

# ----
# draw sightlines from single point
number_slider_9 = Slider(124, range=0..200)  # disabled
number_slider_10 = Slider(91, range=0..100)  # disabled
path_2 = DataPath(number_slider_9)  # disabled
item = TreeItem(Tree=c_script.A, Path=path_2, Index=number_slider_10, Wrap=True)  # disabled

# ----
# input is the number of sight lines to each point from the selected points
# cumulative color mesh
path_3 = FilePath("C:\Users\r.hudson\Documents\WORK\projects\LostCity\LostCity\LostCity\bin\Debug\ciudadPViewShedSingleP.csv")  # disabled
c_script_3 = CSharpScript(path=path_3)  # -> out, A; inputs path: String; disabled
# ---------- c_script_3: C# ----------
    StreamReader sr = new StreamReader(path);
    string line = sr.ReadLine();
    DataTree<int> visscores = new DataTree<int>();
    int row = 0;
    int visScore = 0;
    while(line != null)
    {
      string[] ele = line.Split(',');
      for(int i = 0;i < ele.Length;i++)
      {
        visScore = Convert.ToInt32(ele[i]);
        visscores.Add(visScore, new GH_Path(row));
      }
      row++;
      line = sr.ReadLine();
    }

    sr.Close();
    A = visscores;
# ---------- end c_script_3 ----------
flatten = FlattenTree(Tree=c_script_3.A, Path="{0}")  # disabled
bnd = Bounds(Numbers=flatten)  # disabled
demesh = DeconstructMesh(Mesh=del)  # -> Vertices, Faces, Colours, Normals; disabled
dedomain = DeconstructDomain(Domain=bnd)  # -> Start, End; disabled
gradient = Gradient(
    LowerLimit=dedomain.Start,
    UpperLimit=dedomain.End,
    Parameter=flatten,
    stops=[0: RGB(105, 105, 105), 0.994: RGB(255, 255, 255)])  # disabled

subtraction_5 = Subtraction(A=_11_139999999999999, B=subtraction_4)  # disabled
division_2 = Division(A=subtraction_2, B=subtraction_5)  # disabled
eval = EvaluateCurve(Curve=reparameterize(W), Parameter=division_2)  # -> Point, Tangent, Angle; disabled
eval_2 = EvaluateCurve(Curve=reparameterize(E), Parameter=division_2)  # -> Point, Tangent, Angle; disabled
ln = Line(StartPoint=eval_2.Point, EndPoint=eval.Point)  # disabled
eval_3 = EvaluateCurve(Curve=reparameterize(ln), Parameter=division)  # -> Point, Tangent, Angle; disabled
project = ProjectPoint(Point=eval_3.Point, Direction=Z, Geometry=del)  # -> Point, Index; disabled
cp = ClosestPoint(Point=project.Point, Cloud=demesh.Vertices)  # -> ClosestPoint, CPIndex, Distance; disabled
c_script_4 = CSharpScript(pts=c_script.A, p=cp.ClosestPoint)  # -> out, A; inputs pts: tree of Point3d, p: Point3d; disabled
# ---------- c_script_4: C# ----------
    double dist = 0;
    double mindist = 100000000;
    GH_Path path;
    int[] index = new int[2];
    for(int i = 0;i < pts.BranchCount;i++)
    {
      path = new GH_Path(i);
      for(int j = 0;j < pts.Branch(i).Count;j++)
      {
        dist = pts[path, j].DistanceTo(p);
        if(dist < mindist)
        {
          mindist = dist;
          index[0] = i;
          index[1] = j;
        }
      }
    }
    A =index;
# ---------- end c_script_4 ----------

c_script_5 = CSharpScript(points=c_script.A, path=path_3)  # -> out, A; inputs points: tree of Point3d, path: String; disabled
# ---------- c_script_5: C# ----------
    StreamReader sr = new StreamReader(path);
    string line = sr.ReadLine();
    DataTree<Point3d> pts = new DataTree<Point3d>();
    int row = 0;
    int visScore = 0;
    while(line != null)
    {
      string[] ele = line.Split(',');
      for(int i = 0;i < ele.Length;i++)
      {
        visScore = Convert.ToInt32(ele[i]);
        if(visScore > 0)
        {
          Point3d sp = points[new GH_Path(Convert.ToInt32(row)), Convert.ToInt32(i)];
          pts.Add(sp);
        }
      }
      row++;
      line = sr.ReadLine();
    }

    sr.Close();
    A = pts;
# ---------- end c_script_5 ----------
ln_2 = Line(StartPoint=item, EndPoint=c_script_5.A)  # disabled

gradient_2 = Gradient(
    LowerLimit=dedomain.Start,
    UpperLimit=dedomain.End,
    Parameter=flatten,
    stops=[0: RGBA(255, 255, 255, 0), 0: RGB(170, 235, 41), 0: RGB(0, 98, 0), 0: RGB(81, 175, 17), 1: RGB(255, 255, 0)])  # disabled

conmesh = ConstructMesh(Vertices=demesh.Vertices, Faces=demesh.Faces, Colours=gradient_2)  # disabled
