# Grasshopper definition 3doutGEOREF.gh (Grasshopper 0.9.76)

number_slider = Slider(2, range=0..10)  # disabled
number_slider_2 = Slider(2, range=0..10)  # disabled
toggle = BooleanToggle(False)  # disabled
panel = Panel("""Buritaca 200 (Ciudad Perdida)
Koskunguena
Pirámide (Julepia)
Nulicuandecue
Alto de Mira
Tankua
Casa Troja
Frontera
Jacinto
Vallecito
Pueblo Indio
Gabriel
Lozano
Piedra Redonda
Purgatorio
Zancudo
Tigres
Fronterita
Piscina
Garaje arriba
Helipuerto II
Páramo
La Isla
La Estrella
Isla arriba
Morro enfrente
Pañuelo
Gorgona
Valle Perdido
Seis Planadas
Finca Jacinto
Hormiguero
Test""")
pt = Point([<point referenced from the Rhino model> x33])

# ----
# mesh
number_slider_3 = Slider(108000, range=0..1000000)
path = FilePath("C:\Users\r.hudson\Documents\WORK\projects\LostCity\LostCity\LostCity\bin\Debug\demheader.csv")
c_script = CSharpScript(path=path, scaleF=number_slider_3)  # -> out, A, N, W, cellW; inputs path: String, scaleF: Double
# ---------- c_script: C# ----------
    DataTree<Point3d> pts = new DataTree<Point3d>();
    GH_Path ghpath;
    StreamReader sr = new StreamReader(path);
    string line = sr.ReadLine();
    string[] ele = line.Split(',');
    double startX = Convert.ToDouble(ele[3]);
    double startY = Convert.ToDouble(ele[1]);
    double cell = Convert.ToDouble(ele[5]);
    int row = 0;

    line = sr.ReadLine();
    while(line != null)
    {
      ele = line.Split(',');
      ghpath = new GH_Path(row);
      for(int i = 0;i < ele.Length;i++)
      {

        Point3d p = new Point3d(startX + (i * cell * scaleF), startY + (row * -cell * scaleF), Convert.ToDouble(ele[i]));
        pts.Add(p, ghpath);

      }
      row++;
      line = sr.ReadLine();
    }

    sr.Close();
    A = pts;
    N = startY;
    W = startX;
    cellW = cell;
# ---------- end c_script ----------
del = DelaunayMesh(Points=flatten(c_script.A), Plane=PlaneXY(0, 0, 0))

# ----
# Scale to LAT LON export coords
crv = Curve([<curve referenced from the Rhino model> x70])
crv_2 = Curve([<curve referenced from the Rhino model> x35])
crv_3 = Curve([<curve referenced from the Rhino model> x29])
one_over_x = OneOverX(Value=number_slider_3)
pt_2 = ConstructPoint(XCoordinate=c_script.W, YCoordinate=c_script.N, ZCoordinate=0)
scale = Scale(Geometry=crv, Center=pt_2, Factor=one_over_x)  # -> Geometry, Transform
scale_2 = Scale(Geometry=crv_2, Center=pt_2, Factor=one_over_x)  # -> Geometry, Transform
scale_3 = Scale(Geometry=crv_3, Center=pt_2, Factor=one_over_x)  # -> Geometry, Transform
cp = ControlPoints(Curve=scale.Geometry)  # -> Points, Weights, Knots
cp_2 = ControlPoints(Curve=scale_2.Geometry)  # -> Points, Weights, Knots
cp_3 = ControlPoints(Curve=scale_3.Geometry)  # -> Points, Weights, Knots
c_script_2 = CSharpScript(coords=cp.Points, file="rios.csv")  # -> out, A; inputs coords: tree of Point3d, names: list of String, file: String
# ---------- c_script_2: C# ----------
    StreamWriter sw = new StreamWriter(@"C:\Users\r.hudson\Documents\WORK\projects\LostCity\georefObjects\" + file);

    //Point3d p = new Point3d(startX + (i * cell * scaleF), startY + (row * -cell * scaleF), Convert.ToDouble(ele[i]) * scaleF);

    for(int i = 0;i < coords.BranchCount;i++)
    {
      if(names.Count > 0) sw.Write(names[i] + ",");
      for(int j = 0;j < coords.Branch(i).Count;j++)
      {
        if(j == coords.Branch(i).Count - 1){
          sw.WriteLine(coords.Branch(i)[j].X + "," + coords.Branch(i)[j].Y);
        }
        else {
          sw.Write(coords.Branch(i)[j].X + "," + coords.Branch(i)[j].Y + ",");
        }
      }
    }
    sw.Close();
# ---------- end c_script_2 ----------

crv_4 = Curve(crv_3)  # disabled
cp_4 = ControlPoints(Curve=crv_4)  # -> Points, Weights, Knots; disabled
lng = ListLength(List=cp_4.Points)  # disabled
multiplication = Multiplication(A=lng, B=number_slider)  # disabled
reb = RebuildCurve(Curve=graft(crv_4), Degree=number_slider_2, Count=multiplication, Tangents=toggle)  # disabled
number_slider_4 = Slider(1, range=0..1)
area = Area(Geometry=crv_3)  # -> Area, Centroid
number_slider_5 = Slider(100, range=0..100)
c_script_3 = CSharpScript(sitios=crv_3, namePts=pt, nametext=panel)  # -> out, A; inputs sitios: list of Curve, namePts: list of Point3d, nametext: list of String
# ---------- c_script_3: C# ----------
    List<string> orderednames = new List<string>();
    for(int i = 0;i < sitios.Count;i++)
    {
      double minDist = 10000000000000;
      double dist = 0;
      int index = 0;
      double t = 0;
      for(int j = 0;j < namePts.Count;j++)
      {
        sitios[i].ClosestPoint(namePts[j], out t);
        Point3d oncurve = sitios[i].PointAt(t);
        dist = oncurve.DistanceTo(namePts[j]);
        if(dist < minDist){
          minDist = dist;
          index = j;
        }
      }
      if(minDist < 140)orderednames.Add(nametext[index]);

    }
    A = orderednames;
# ---------- end c_script_3 ----------
tag = TextTag3D(Location=area.Centroid, Text=c_script_3.A, Size=Slider(140, range=0..1000), Justification=7)
number_slider_6 = Slider(1000, range=0..1000)
item = ListItem(List=crv_3, Index=0, Wrap=True)
Z = UnitZ(Factor=expr("-x", Slider(3587, range=0..10000)))
c_script_4 = CSharpScript(coords=cp_3.Points, names=c_script_3.A, file="sitios.csv")  # -> out, A; inputs coords: tree of Point3d, names: list of String, file: String; same code as c_script_2
c_script_5 = CSharpScript(coords=cp_2.Points, file="caminos.csv")  # -> out, A; inputs coords: tree of Point3d, names: list of String, file: String; same code as c_script_2
incurve = PointInCurve(Point=flatten(c_script.A), Curve=item)  # -> Relationship, Point
equals = Equality(FirstNumber=incurve.Relationship, SecondNumber=Slider(2, range=0..10))  # -> Equality, Inequality
ma = MassAddition(Input=equals.Equality)  # -> Result, PartialResults

# ----
# Point locator
# outputs row column indices for a ref point
panel_2 = Panel("""11.140131, 10.975654, -74.000914, -73.836385

CP 11.037920, -73.925191""")  # disabled
number_slider_7 = Slider(0.00083333, range=0..0.001)  # disabled
number_slider_8 = Slider(179, range=0..1000)  # disabled
multiplication_2 = Multiplication(A=number_slider_8, B=number_slider_7)  # disabled
number_slider_9 = Slider(11.037, range=0..100)  # disabled
_11_139999999999999 = Number(11.14)  # disabled
number_slider_10 = Slider(-73.925191, range=-180..100)  # disabled
_74_000833333333333 = Number(-74.00083333)  # disabled
addition = Addition(A=_74_000833333333333, B=multiplication_2)  # disabled
subtraction = Subtraction(A=addition, B=_74_000833333333333)  # disabled
subtraction_2 = Subtraction(A=_11_139999999999999, B=number_slider_9)  # disabled
subtraction_3 = Subtraction(A=addition, B=number_slider_10)  # disabled
division = Division(A=subtraction_3, B=subtraction)  # disabled
W = Curve(<curve referenced from the Rhino model>)  # disabled
E = Curve(<curve referenced from the Rhino model>)  # disabled
Z_2 = UnitZ(Factor=1)  # disabled

subtraction_4 = Subtraction(A=_11_139999999999999, B=multiplication_2)  # disabled

# ----
# draw sightlines from single point
number_slider_11 = Slider(124, range=0..200)  # disabled
number_slider_12 = Slider(91, range=0..100)  # disabled
path_2 = DataPath(number_slider_11)  # disabled
item_2 = TreeItem(Path=path_2, Index=number_slider_12, Wrap=True)  # disabled

# ----
# input is the number of sight lines to each point from the selected points
# cumulative color mesh
path_3 = FilePath("C:\Users\r.hudson\Documents\WORK\projects\LostCity\LostCity\LostCity\bin\Debug\topThreeAreaViewShed.csv")
c_script_6 = CSharpScript(path=path_3)  # -> out, A; inputs path: String
# ---------- c_script_6: C# ----------
    StreamReader sr = new StreamReader(path);
    string line = sr.ReadLine();
    DataTree<int> visscores = new DataTree<int>();
    int row = 0;
    int visScore = 0;
    while(line != null)
    {
      string[] ele = line.Split(',');
      for(int i = 0;i < ele.Length;i++)
      {
        visScore = Convert.ToInt32(ele[i]);
        visscores.Add(visScore, new GH_Path(row));
      }
      row++;
      line = sr.ReadLine();
    }

    sr.Close();
    A = visscores;
# ---------- end c_script_6 ----------
flatten = FlattenTree(Tree=c_script_6.A, Path="{0}")
bnd = Bounds(Numbers=flatten)
demesh = DeconstructMesh(Mesh=del)  # -> Vertices, Faces, Colours, Normals
dedomain = DeconstructDomain(Domain=bnd)  # -> Start, End

panel_3 = Panel(c_script_6.A)

subtraction_5 = Subtraction(A=_11_139999999999999, B=subtraction_4)  # disabled
division_2 = Division(A=subtraction_2, B=subtraction_5)  # disabled
eval = EvaluateCurve(Curve=reparameterize(W), Parameter=division_2)  # -> Point, Tangent, Angle; disabled
eval_2 = EvaluateCurve(Curve=reparameterize(E), Parameter=division_2)  # -> Point, Tangent, Angle; disabled
ln = Line(StartPoint=eval_2.Point, EndPoint=eval.Point)  # disabled
eval_3 = EvaluateCurve(Curve=reparameterize(ln), Parameter=division)  # -> Point, Tangent, Angle; disabled
project = ProjectPoint(Point=eval_3.Point, Direction=Z_2, Geometry=del)  # -> Point, Index; disabled
cp_5 = ClosestPoint(Point=project.Point, Cloud=demesh.Vertices)  # -> ClosestPoint, CPIndex, Distance; disabled
c_script_7 = CSharpScript(p=cp_5.ClosestPoint)  # -> out, A; inputs pts: tree of Point3d, p: Point3d; disabled
# ---------- c_script_7: C# ----------
    double dist = 0;
    double mindist = 100000000;
    GH_Path path;
    int[] index = new int[2];
    for(int i = 0;i < pts.BranchCount;i++)
    {
      path = new GH_Path(i);
      for(int j = 0;j < pts.Branch(i).Count;j++)
      {
        dist = pts[path, j].DistanceTo(p);
        if(dist < mindist)
        {
          mindist = dist;
          index[0] = i;
          index[1] = j;
        }
      }
    }
    A =index;
# ---------- end c_script_7 ----------

c_script_8 = CSharpScript(path=path_3)  # -> out, A; inputs points: tree of Point3d, path: String; disabled
# ---------- c_script_8: C# ----------
    StreamReader sr = new StreamReader(path);
    string line = sr.ReadLine();
    DataTree<Point3d> pts = new DataTree<Point3d>();
    int row = 0;
    int visScore = 0;
    while(line != null)
    {
      string[] ele = line.Split(',');
      for(int i = 0;i < ele.Length;i++)
      {
        visScore = Convert.ToInt32(ele[i]);
        if(visScore > 0)
        {
          Point3d sp = points[new GH_Path(Convert.ToInt32(row)), Convert.ToInt32(i)];
          pts.Add(sp);
        }
      }
      row++;
      line = sr.ReadLine();
    }

    sr.Close();
    A = pts;
# ---------- end c_script_8 ----------
ln_2 = Line(StartPoint=item_2, EndPoint=c_script_8.A)  # disabled

gradient = Gradient(
    LowerLimit=dedomain.End,
    UpperLimit=dedomain.Start,
    Parameter=flatten,
    stops=[0: RGB(234, 38, 0), 0.25: RGB(234, 126, 0), 0.494: RGB(254, 244, 84), 0.751: RGB(173, 203, 249), 1: RGB(75, 107, 169)])
move = Move(Geometry=demesh.Vertices, Motion=Z)  # -> Geometry, Transform

conmesh = ConstructMesh(Vertices=move.Geometry, Faces=demesh.Faces, Colours=gradient)
