# Grasshopper definition testingGeoCoords.gh (Grasshopper 0.9.76)

file = ReadFile(File="C:\Users\Admin\Documents\projects\LostCity\LostCity\LostCity\bin\Debug\dempoints.csv", PerLineParse=True)
panel = Panel(file)
split = TextSplit(Text=panel, Separators=",")
item = ListItem(List=split, Index=0, Wrap=True)  # -> flatten(Item)
item_2 = ListItem(List=split, Index=Slider(1, range=0..1), Wrap=True)  # -> flatten(Item)
item_3 = ListItem(List=split, Index=Slider(2, range=0..10), Wrap=True)  # -> flatten(Item)
multiplication = Multiplication(A=item_3, B=Slider(2, range=0..10))
pt = ConstructPoint(XCoordinate=expr("x*100", item_2), YCoordinate=expr("x*100", item), ZCoordinate=0)
rad = Radians(Degrees=item)
rad_2 = Radians(Degrees=item_2)
del = DelaunayMesh(Points=pt, Plane=PlaneXY(0, 0, 0))
addition = Addition(A=multiplication, B=Slider(40000000, range=0..100000000))
demesh = DeconstructMesh(Mesh=del)  # -> Vertices, Faces, Colours, Normals
pt_2 = PointPolar(BasePlane=PlaneXY(0, 0, 0), XYAngle=rad_2, ZAngle=0, Offset=item_3)  # disabled
pt_3 = PointPolar(BasePlane=PlaneXY(0, 0, 0), XYAngle=rad_2, ZAngle=rad, Offset=addition)
conmesh = ConstructMesh(Vertices=pt_3, Faces=demesh.Faces)
